# Grasshopper definition doorBoxOut_MultiBox_Nested.gh (Grasshopper 1.0.8)
# Copyright: María Sánchez Domínguez
# plug-ins: DataB Toolkit, DataB.Components, eleFront

path = FilePath("C:\Users\maria\Desktop\assets\DoorBoxOut_Params_Variations_OK.csv")
file = ReadFile(File=path, PerLineParse=True)
split = TextSplit(Text=file, Separators=",")
flip = FlipMatrix(Data=split)
cull_i = CullIndex(List=flip, Indices="0", Wrap=True)
# Parameters
bang = ExplodeTree(Data=cull_i)  # -> _0000, _0010, _0020, _0030
maxrh_height = Panel("1400")

boxdepth = Slider(300, range=150..450)
boxheight = Slider(1790, range=600..2600)
boxwidth = Slider(946, range=800..1000)

filmthickness = Slider(21, range=15..25)
kieferthickness = Slider(21, range=15..25)
fb_width_h = Slider(186, range=140..200)
sideoffsettoc = Panel("100")

r_thickness = Slider(22, range=12..25)
r_height = Slider(343, range=250..450)

h_distance = Slider(100, range=80..150)
h_number = Slider(5, range=3..8)

fb_width_v = Slider(169, range=140..200)
r_holey = Slider(105, range=100..110)
r_holex = Slider(100, range=100..110)
boxdepth_2 = Integer(bang._0010)
boxwidth_2 = Integer(bang._0030)
# Boolean Checks
boxheight_2 = Integer(bang._0020)
tooldiameter_0 = Number(0)
maxrh_height_2 = Integer(maxrh_height)
expression = Expression(Expression="null")
boxheight_3 = GetInteger(boxheight_2, AtLeast=1, AtMost=1, Maximum=2147483647, Minimum=-2147483648, TreeAccess=True)
boxwidth_3 = GetInteger(boxwidth_2, AtLeast=1, AtMost=1, Maximum=2147483647, Minimum=-2147483648, TreeAccess=True)
boxdepth_3 = GetInteger(boxdepth_2, AtLeast=1, AtMost=1, Maximum=2147483647, Minimum=-2147483648, TreeAccess=True)
r_holey_2 = Integer(r_holey)
r_holex_2 = Integer(r_holex)
sideoffsettoc_2 = GetInteger(sideoffsettoc, AtLeast=1, AtMost=1, Maximum=2147483647, Minimum=-2147483648, TreeAccess=False)
maxrh_height_3 = GetInteger(maxrh_height_2, AtLeast=1, AtMost=1, Maximum=2147483647, Minimum=-2147483648, TreeAccess=False)
filmthickness_2 = GetInteger(filmthickness, AtLeast=1, AtMost=1, Maximum=2147483647, Minimum=-2147483648, TreeAccess=False)
kieferthickness_2 = GetInteger(kieferthickness, AtLeast=1, AtMost=1, Maximum=2147483647, Minimum=-2147483648, TreeAccess=False)
fb_width_h_2 = GetInteger(fb_width_h, AtLeast=1, AtMost=1, Maximum=2147483647, Minimum=-2147483648, TreeAccess=False)
fb_width_v_2 = GetInteger(fb_width_v, AtLeast=1, AtMost=1, Maximum=2147483647, Minimum=-2147483648, TreeAccess=False)
r_height_2 = GetInteger(r_height, AtLeast=1, AtMost=1, Maximum=2147483647, Minimum=-2147483648, TreeAccess=False)
r_thickness_2 = GetInteger(r_thickness, AtLeast=1, AtMost=1, Maximum=2147483647, Minimum=-2147483648, TreeAccess=False)
h_distance_2 = GetInteger(h_distance, AtLeast=1, AtMost=1, Maximum=2147483647, Minimum=-2147483648, TreeAccess=False)
h_number_2 = GetInteger(h_number, AtLeast=1, AtMost=1, Maximum=2147483647, Minimum=-2147483648, TreeAccess=False)
nullplaceholder = Data(expression)
# Output
lng = ListLength(List=boxheight_3)

boxdepth_4 = Integer(flatten(boxdepth_3))
boxheight_4 = Integer(flatten(boxheight_3))
boxwidth_4 = Integer(flatten(boxwidth_3))

kieferthickness_3 = Integer(kieferthickness_2)
fb_width_h_3 = Integer(fb_width_h_2)
fb_width_v_3 = Integer(fb_width_v_2)
filmthickness_3 = Integer(filmthickness_2)

maxrh_height_4 = Integer(maxrh_height_3)
box = DomainBox(Base=PlaneXY(0, 0, 0), X=boxwidth_4, Y=boxdepth_4, Z=boxheight_4)

r_height_3 = Integer(r_height_2)
r_thickness_3 = Integer(r_thickness_2)
h_distance_3 = Integer(h_distance_2)
h_number_perside = Integer(h_number_2)

debrep = DeconstructBrep(Brep=box)  # -> Faces, Edges, Vertices
area = Area(Geometry=debrep.Faces)  # -> Area, Centroid
pdecon = Deconstruct(Point=area.Centroid)  # -> XComponent, YComponent, ZComponent
sort = SortList(Keys=pdecon.ZComponent, ValuesA=debrep.Faces, ValuesB=area.Centroid)  # -> Keys, ValuesA, ValuesB
cluster = Cluster(L=sort.ValuesA)  # -> i, item_1, i_2, item_1_2
item = ListItem(List=sort.ValuesA, Index=0, Wrap=True)
item_2 = ListItem(List=sort.ValuesB, Index=0, Wrap=True)
Z = UnitZ(Factor=filmthickness_3)
Z_2 = UnitZ(Factor=1)

front = Surface(cluster.i)
back = Surface(cluster.item_1)
right = Surface(cluster.i_2)
left = Surface(cluster.item_1_2)

# ---- group: Front/Back_Horizontal
X = UnitX(Factor=1)
edgesdir = EdgesFromDirections(Brep=front, Directions=X, Reflex=True, Angle=0)  # -> Edges, Indices, Map
fb_width_h_4 = Integer(fb_width_h_3)
item_3 = ListItem(List=edgesdir.Edges, Index=0, Wrap=True)  # -> Item, Item1
Z_3 = UnitZ(Factor=fb_width_h_4)
neg = Negative(Value=Z_3)
extr = Extrude(Base=item_3.Item, Direction=Z_3)
extr_2 = Extrude(Base=item_3.Item1, Direction=neg)

# ----
fb_width_h_5 = Integer(fb_width_h_3)
fb_width_h_2_2 = Integer(expr("x*2", fb_width_h_3))
boxheight_5 = Integer(boxheight_4)
neg_2 = Negative(Value=fb_width_h_5)
subtraction = Subtraction(A=boxheight_5, B=fb_width_h_2_2)
fb_width_v_height = Integer(subtraction)
boxdepth_2_2 = Number(expr("x/2", boxdepth_4))
graft = GraftTree(Tree=boxdepth_4, IncludeEmptyLists=True, IncludeNullItems=True)
rthickness_2 = Integer(expr("x/2", [filmthickness_3, r_thickness_3]))

maxrh_height_5 = Integer(maxrh_height_4)
boxheight_6 = Integer(boxheight_4)
smaller = SmallerThan(FirstNumber=boxheight_6, SecondNumber=maxrh_height_5)  # -> SmallerThan, OrEqualTo
r_h_yes_no = Boolean(smaller.OrEqualTo)

nullplaceholder_2 = Data(nullplaceholder)
filmthickness_2_2 = Number(expr("x*2", filmthickness_3))
list = ValueList({"Reference Tab Size": 0, "Proportional Tab Size": 1}, selected="Proportional Tab Size")
tooldiameter = Number(tooldiameter_0)

standard_options = StandardOptions()
kieferfilm_options = KieferFilmOptions()
duckfeet_a_b_options = DuckFeetABOptions()
t_slot_options = TSlotOptions()
list_2 = ValueList({"Standard Options": 0, "T Slot Options": 1, "KieferFilm Options": 2, "DuckFeet A-B Options": 3}, selected="Standard Options")
filter = StreamFilter(Gate=list_2, Stream0=standard_options, Stream1=t_slot_options, Stream2=kieferfilm_options, Stream3=duckfeet_a_b_options)

tooldiameter_2 = Number(tooldiameter_0)
partwithtabs = Panel("FB_V")

panel = Panel("""440
140
425
45
115
45
425
140
440""")
py3 = Python3Script(L="2220", D=panel)  # -> out, P; inputs L: Int32, D: list of Int32
# ---------- py3: Python ----------
"""
Inputs:
    L: Absolute reference length (float)
    D: List of partial lengths (list of floats)
Outputs:
    P: List of proportions relative to the unit (L / len(D))
"""

if L and D:
    unit = L / len(D)
    P = [d / unit for d in D]
# ---------- end py3 ----------

# ----
# FB_V / S
tooldiameter_3 = Number(tooldiameter_0)
# FB_H / S
tooldiameter_4 = Number(tooldiameter_0)
partwithtabs_2 = Panel("FB_H")

panel_2 = Panel("""60
46
350
144
350
46
60""")
py3_2 = Python3Script(L="1208", D=panel_2)  # -> out, P; inputs L: Int32, D: list of Int32; same code as py3

tooldiameter_5 = Number(tooldiameter_0)
panel_3 = Panel("""False
True
False""")
film = Panel("""S
T
R""")

brep = Brep([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])

# ---- group: Grouped by Name/Type
item_4 = ListItem(List=brep, Index=0, Wrap=True)  # -> Item, Item1, Item2, Item3, Item4, Item5, Item6, Item7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
merge = Merge(Data1=item_4.Item, Data2=item_4.Item1)
merge_2 = Merge(Data1=item_4.Item2, Data2=item_4.Item3)
merge_3 = Merge(Data1=item_4.Item9, Data2=item_4.Item10, Data3=item_4.Item11, Data4=item_4.Item12)
merge_4 = Merge(Data1=item_4.Item13, Data2=item_4.Item14, Data3=item_4.Item15, Data4=item_4.Item16)
merge_5 = Merge(Data1=item_4.Item18, Data2=item_4.Item17, Data3=item_4.Item19, Data4=item_4.Item20)
namecreator = NameCreator(L=merge, A="T")  # -> R, C
namecreator_2 = NameCreator(L=merge_2, A="S")  # -> R, C
namecreator_3 = NameCreator(L=item_4.Item8, A="C")  # -> R, C
namecreator_4 = NameCreator(L=merge_5, A="R")  # -> R, C
panel_4 = Panel(namecreator.R)
panel_5 = Panel(namecreator_2.R)
panel_6 = Panel(namecreator_3.R)
panel_7 = Panel(namecreator_4.R)

# ----
merge_6 = Merge(
    Data1=item_4.Item25,
    Data2=item_4.Item6,
    Data3=item_4.Item26,
    Data4=item_4.Item27,
    Data5=item_4.Item28,
    Data6=item_4.Item29,
    Data7=item_4.Item7,
    Data8=item_4.Item30,
    Data9=item_4.Item31,
    Data10=item_4.Item32)
namecreator_5 = NameCreator(L=merge_6, A="H")  # -> R, C
panel_8 = Panel(namecreator_5.R)

rev = ReverseList(List=merge_3)
rev_2 = ReverseList(List=merge_4)

# ---- group: Grouped by Name/Type (continued)
namecreator_6 = NameCreator(L=rev, A="F")  # -> R, C
namecreator_7 = NameCreator(L=rev_2, A="B")  # -> R, C
panel_9 = Panel(namecreator_6.R)
panel_10 = Panel(namecreator_7.R)

# ----
b_names = Text(namecreator_7.R)
h_names = Text(namecreator_5.R)
t_names = Text(namecreator.R)
c_names = Text(namecreator_3.R)
f_names = Text(namecreator_6.R)
r_names = Text(namecreator_4.R)
s_names = Text(namecreator_2.R)

panel_11 = Panel("""False
False
True
True""")
f_names_2 = Text(f_names)
b_names_2 = Text(b_names)
dispatch = Dispatch(List=f_names_2, DispatchPattern=panel_11)  # -> ListA, ListB
dispatch_2 = Dispatch(List=b_names_2, DispatchPattern=panel_11)  # -> ListA, ListB
merge_7 = Merge(Data1=dispatch.ListA, Data2=dispatch_2.ListA)
merge_8 = Merge(Data1=dispatch.ListB, Data2=dispatch_2.ListB)

fb_v_names = Text(merge_7)
fb_h_names = Text(merge_8)

number_slider = Slider(7, range=0..10)
series = Series(Start=0, Step=1, Count=number_slider)
gradient = Gradient(
    LowerLimit=0,
    UpperLimit=expr("x-1", number_slider),
    Parameter=series,
    stops=[0: RGB(243, 57, 0), 0.1: RGB(236, 27, 60), 0.2: RGB(210, 0, 118), 0.3: RGB(103, 0, 120), 0.4: RGB(39, 72, 161), 0.5: RGB(1, 192, 229), 0.6: RGB(18, 178, 90), 0.7: RGB(79, 186, 8), 0.8: RGB(220, 237, 32), 0.9: RGB(247, 159, 20), 1: RGB(243, 57, 0)])

ahsl = SplitAHSL(Colour=gradient)  # -> Alpha, Hue, Saturation, Luminance
hsl = ColourHSL(Alpha=Slider(0.3, range=0..1), Hue=ahsl.Hue, Saturation=ahsl.Saturation, Luminance=ahsl.Luminance)

item_5 = ListItem(List=hsl, Index=0, Wrap=True)  # -> Item, Item1, Item2, Item3, Item4, Item5, Item6

# ---- group: Grouped by Name/Type
dot = AnnotationDot(Location=namecreator.C, PrimaryText=namecreator.R)  # -> AnnotationDot, Location, PrimaryText
preview = CustomPreview(Geometry=merge, Material=item_5.Item)
preview_2 = CustomPreview(Geometry=dot.AnnotationDot, Material=item_5.Item)

dot_2 = AnnotationDot(Location=namecreator_2.C, PrimaryText=namecreator_2.R)  # -> AnnotationDot, Location, PrimaryText
preview_3 = CustomPreview(Geometry=[merge_2, item_4.Item4, item_4.Item5], Material=item_5.Item1)
preview_4 = CustomPreview(Geometry=dot_2.AnnotationDot, Material=item_5.Item1)

dot_3 = AnnotationDot(Location=namecreator_3.C, PrimaryText=namecreator_3.R)  # -> AnnotationDot, Location, PrimaryText
preview_5 = CustomPreview(Geometry=item_4.Item8, Material=item_5.Item2)
preview_6 = CustomPreview(Geometry=dot_3.AnnotationDot, Material=item_5.Item2)

dot_4 = AnnotationDot(Location=namecreator_6.C, PrimaryText=namecreator_6.R)  # -> AnnotationDot, Location, PrimaryText
preview_7 = CustomPreview(Geometry=merge_3, Material=item_5.Item3)
preview_8 = CustomPreview(Geometry=dot_4.AnnotationDot, Material=item_5.Item3)

dot_5 = AnnotationDot(Location=namecreator_7.C, PrimaryText=namecreator_7.R)  # -> AnnotationDot, Location, PrimaryText
preview_9 = CustomPreview(Geometry=merge_4, Material=item_5.Item4)
preview_10 = CustomPreview(Geometry=dot_5.AnnotationDot, Material=item_5.Item4)

dot_6 = AnnotationDot(Location=namecreator_4.C, PrimaryText=namecreator_4.R)  # -> AnnotationDot, Location, PrimaryText
preview_11 = CustomPreview(Geometry=merge_5, Material=item_5.Item5)
preview_12 = CustomPreview(Geometry=dot_6.AnnotationDot, Material=item_5.Item5)

# ----
dot_7 = AnnotationDot(Location=namecreator_5.C, PrimaryText=namecreator_5.R)  # -> AnnotationDot, Location, PrimaryText
preview_13 = CustomPreview(Geometry=merge_6, Material=item_5.Item6)
preview_14 = CustomPreview(Geometry=dot_7.AnnotationDot, Material=item_5.Item6)

ahsl_2 = SplitAHSL(Colour=gradient)  # -> Alpha, Hue, Saturation, Luminance
hsl_2 = ColourHSL(Alpha=Slider(0.4, range=0..1), Hue=ahsl_2.Hue, Saturation=ahsl_2.Saturation, Luminance=ahsl_2.Luminance)

# ---- group: Front/Back_Vertical
edgesdir_2 = EdgesFromDirections(Brep=front, Directions=Z_2, Reflex=True, Angle=0)  # -> Edges, Indices, Map
fb_width_v_4 = Integer(fb_width_v_3)
X_2 = UnitX(Factor=fb_width_v_4)
neg_3 = Negative(Value=X_2)
panel_12 = Panel("0,0")
kieferthickness_4 = Integer(kieferthickness_3)

# ----
ext = ExtendCurve(Curve=edgesdir_2.Edges, Type=0, Start=neg_2, End=neg_2)

# ---- group: Front/Back_Vertical (continued)
item_6 = ListItem(List=ext, Index=0, Wrap=True)  # -> Item, Item1
extr_3 = Extrude(Base=item_6.Item, Direction=X_2)
extr_4 = Extrude(Base=item_6.Item1, Direction=neg_3)
evalsrf = EvaluateSurface(Surface=extr_3, Point=panel_12)  # -> Point, Normal, UDirection, VDirection, Frame
neg_4 = Negative(Value=evalsrf.Normal)
amp = Amplitude(Vector=neg_4, Amplitude=kieferthickness_4)

# ---- group: Sides
boxdepth_5 = Integer(graft)
merge_9 = Merge(Data1=right, Data2=left)
Y = UnitY(Factor=boxdepth_5)
extr_5 = Extrude(Base=edgesdir_2.Edges, Direction=Y)
evalsrf_2 = EvaluateSurface(Surface=merge_9, Point="0,0")  # -> Point, Normal, UDirection, VDirection, Frame
filmthickness_4 = Integer(filmthickness_3)
amp_2 = Amplitude(Vector=evalsrf_2.Normal, Amplitude=filmthickness_4)
extr_6 = Extrude(Base=extr_5, Direction=amp_2)
item_7 = ListItem(List=extr_6, Index=0, Wrap=True)  # -> Item, Item1

# ---- group: Front/Back_Horizontal
extr_7 = Extrude(Base=extr, Direction=amp)
extr_8 = Extrude(Base=extr_2, Direction=amp)
xz = XZPlane(Origin=item_2)
mirror = Mirror(Geometry=extr_7, Plane=xz)  # -> Geometry, Transform
mirror_2 = Mirror(Geometry=extr_8, Plane=xz)  # -> Geometry, Transform

# ---- group: Front/Back_Vertical
extr_9 = Extrude(Base=extr_3, Direction=amp)
extr_10 = Extrude(Base=extr_4, Direction=amp)
xz_2 = XZPlane(Origin=item_2)
mirror_3 = Mirror(Geometry=extr_9, Plane=xz_2)  # -> Geometry, Transform
mirror_4 = Mirror(Geometry=extr_10, Plane=xz_2)  # -> Geometry, Transform

# ---- group: Back
b_0 = Brep(mirror.Geometry)
b_1 = Brep(mirror_2.Geometry)
b_3 = Brep(mirror_4.Geometry)
b_2 = Brep(mirror_3.Geometry)

# ---- group: Front
f_1 = Brep(extr_8)
f_0 = Brep(extr_7)
f_3 = Brep(extr_10)
f_2 = Brep(extr_9)

# ---- group: Left
s_0 = Brep(item_7.Item)

# ---- group: Right
s_1 = Brep(item_7.Item1)

# ---- group: FB_V
merge_10 = Merge(Data1=f_2, Data2=f_3, Data3=b_2, Data4=b_3)  # -> simplify(Result)

# ---- group: FB_H
merge_11 = Merge(Data1=f_0, Data2=f_1, Data3=b_0, Data4=b_1)  # -> simplify(Result)

# ----
fb_v = Brep(merge_10)
fb_h = Brep(merge_11)

# ---- group: Top/Bottom
filmthickness_5 = Integer(filmthickness_3)
extr_11 = Extrude(Base=item, Direction=Z)
boxheight_7 = Integer(boxheight_4)
subtraction_2 = Subtraction(A=boxheight_7, B=filmthickness_5)
Z_4 = UnitZ(Factor=subtraction_2)  # -> graft(UnitVector)

division = Division(A=boxheight_7, B="2")
division_2 = Division(A=filmthickness_5, B="2")
addition = Addition(A=division, B=division_2)
Z_5 = UnitZ(Factor=addition)
move = Move(Geometry=item_2, Motion=graft(Z_5))  # -> Geometry, Transform

# ----
sdiff = SolidDifference(BrepsA=extr_11, BrepsB=extr_6)

# ---- group: Top/Bottom (continued)
move_2 = Move(Geometry=sdiff, Motion=Z_4)  # -> Geometry, Transform

t_0 = Brep(sdiff)
t_1 = Brep(move_2.Geometry)

# ---- group: Central
eval = EvaluateCurve(Curve=reparameterize(edgesdir_2.Edges), Parameter="0.5")  # -> Point, Tangent, Angle
merge_12 = Merge(Data1=left, Data2=right)
Y_2 = UnitY(Factor=1)
evalsrf_3 = EvaluateSurface(Surface=merge_12, Point=panel_12)  # -> Point, Normal, UDirection, VDirection, Frame
subtraction_3 = Subtraction(A=fb_width_v_3, B=filmthickness_3)
line = LineSDL(Start=eval.Point, Direction=Y_2, Length=boxdepth_5)
neg_5 = Negative(Value=evalsrf_3.Normal)
amp_3 = Amplitude(Vector=neg_5, Amplitude=filmthickness_3)
amp_4 = Amplitude(Vector=neg_5, Amplitude=subtraction_3)
kieferthickness_5 = Integer(kieferthickness_3)
move_3 = Move(Geometry=line, Motion=amp_3)  # -> Geometry, Transform
Z_6 = UnitZ(Factor=expr("-x/2", kieferthickness_5))
Z_7 = UnitZ(Factor=kieferthickness_5)

# ----
amp_5 = Amplitude(Vector=neg_5, Amplitude=expr("x/2", subtraction_3))
tstat = TreeStatistics(Tree=move_3.Geometry)  # -> Paths, graft(Length), Count
dup = DuplicateData(Data=nullplaceholder_2, Number=tstat.Length, Order=True)  # -> simplify(Data)

r_h_yes_no_2 = Boolean(r_h_yes_no)
weave = Weave(Pattern=graft(r_h_yes_no_2), Stream0=move_3.Geometry, Stream1=dup, NullGaps=False)

panel_13 = Panel(r_h_yes_no_2)

# ---- group: Central (continued)
extr_12 = Extrude(Base=weave, Direction=amp_4)
move_4 = Move(Geometry=extr_12, Motion=Z_6)  # -> Geometry, Transform
extr_13 = Extrude(Base=move_4.Geometry, Direction=Z_7)
item_8 = ListItem(List=extr_13, Index=0, Wrap=True)  # -> Item, Item1

# ----
rev_3 = ReverseList(List=extr_13)
h_number_perside_2 = Integer(h_number_perside)
h_distance_4 = Integer(h_distance_3)
Z_8 = UnitZ(Factor=h_distance_4)
subtraction_4 = Subtraction(A=h_number_perside_2, B="2")
neg_6 = Negative(Value=Z_8)
series_2 = Series(Start="1", Step=1, Count=subtraction_4)
multiplication = Multiplication(A=neg_6, B=series_2)
move_5 = Move(Geometry=graft(rev_3), Motion=multiplication)  # -> Geometry, Transform
move_6 = Move(Geometry=extr_13, Motion=Z_8)  # -> Geometry, Transform

pshift = ShiftPaths(Data=move_5.Geometry, Offset=-1)

item_9 = ListItem(List=move_6.Geometry, Index=0, Wrap=True)  # -> Item, Item1
item_10 = ListItem(List=pshift, Index=0, Wrap=True)  # -> Item, Item1, Item2, Item3, Item4, Item5
merge_13 = Merge(
    Data1=item_9.Item1,
    Data2=item_8.Item1,
    Data3=item_10.Item,
    Data4=item_10.Item1,
    Data5=item_10.Item2,
    Data6=item_9.Item,
    Data7=item_8.Item,
    Data8=item_10.Item3,
    Data9=item_10.Item4,
    Data10=item_10.Item5)
item_11 = ListItem(List=merge_13, Index=0, Wrap=True)  # -> Item, Item1, Item2, Item3, Item4, Item5, Item6, Item7, Item8, Item9

# ---- group: H_Reinforcement
h_0 = Brep(item_11.Item)
h_1 = Brep(item_11.Item1)
h_2 = Brep(item_11.Item2)
h_3 = Brep(item_11.Item3)
h_4 = Brep(item_11.Item4)
h_7 = Brep(item_11.Item7)
h_8 = Brep(item_11.Item8)
h_9 = Brep(item_11.Item9)
h_5 = Brep(item_11.Item5)
h_6 = Brep(item_11.Item6)

# ---- group: R
filmthickness_6 = Integer(filmthickness_3)
fb_width_v_5 = Integer(fb_width_v_3)
eval_2 = EvaluateCurve(Curve=reparameterize(edgesdir_2.Edges), Parameter="0")  # -> Point, Tangent, Angle
Y_3 = UnitY(Factor=1)
subtraction_5 = Subtraction(A=fb_width_v_5, B=filmthickness_6)
evalsrf_4 = EvaluateSurface(Surface=merge_12, Point=panel_12)  # -> Point, Normal, UDirection, VDirection, Frame
division_3 = Division(A=subtraction_5, B="2")
line_2 = LineSDL(Start=eval_2.Point, Direction=Y_3, Length=boxdepth_5)
Z_9 = UnitZ(Factor=filmthickness_6)
addition_2 = Addition(A=division_3, B=filmthickness_6, C=rthickness_2)
move_7 = Move(Geometry=line_2, Motion=Z_9)  # -> Geometry, Transform
neg_7 = Negative(Value=evalsrf_4.Normal)
amp_6 = Amplitude(Vector=neg_7, Amplitude=addition_2)
move_8 = Move(Geometry=move_7.Geometry, Motion=amp_6)  # -> Geometry, Transform
r_height_4 = Integer(r_height_3)
Z_10 = UnitZ(Factor=r_height_4)
r_thickness_4 = Integer(r_thickness_3)
X_3 = UnitX(Factor=r_thickness_4)
neg_8 = Negative(Value=X_3)

# ----
merge_14 = Merge(Data1=neg_8, Data2=X_3)
subtraction_6 = Subtraction(A=boxheight_4, B=filmthickness_2_2, C=r_height_4)

# ---- group: CenterPlate
boxwidth_2_2 = Integer(expr("x/2", boxwidth_4))
sideoffsettoh = Integer(sideoffsettoc_2)
subtraction_7 = Subtraction(A=boxwidth_2_2, B=sideoffsettoh)
neg_9 = Negative(Value=subtraction_7)
neg_10 = Negative(Value=boxdepth_2_2)
dom = ConstructDomain(DomainStart=neg_9, DomainEnd=subtraction_7)
dom_2 = ConstructDomain(DomainStart=neg_10, DomainEnd=boxdepth_2_2)
kieferthickness_6 = Integer(kieferthickness_3)
Z_11 = UnitZ(Factor=kieferthickness_6)
f_1_2 = Brep(extr_9)
f_0_2 = Brep(extr_10)
b_1_2 = Brep(mirror_3.Geometry)
b_0_2 = Brep(mirror_4.Geometry)
merge_15 = Merge(Data1=f_1_2, Data2=f_0_2, Data3=b_1_2, Data4=b_0_2)

# ----
graft_2 = GraftTree(Tree=dom, IncludeEmptyLists=True, IncludeNullItems=True)
graft_3 = GraftTree(Tree=dom_2, IncludeEmptyLists=True, IncludeNullItems=True)

# ---- group: CenterPlate (continued)
rectangle = Rectangle(Plane=move.Geometry, XSize=graft_2, YSize=graft_3, Radius=0)  # -> Rectangle, Length
boundary = BoundarySurfaces(Edges=rectangle.Rectangle)
extr_14 = Extrude(Base=boundary, Direction=Z_11)
sdiff_2 = SolidDifference(BrepsA=extr_14, BrepsB=merge_15)

# ----
tstat_2 = TreeStatistics(Tree=sdiff_2)  # -> Paths, graft(Length), Count
nullplaceholder_3 = Data(nullplaceholder)
r_h_yes_no_3 = Boolean(r_h_yes_no)
dup_2 = DuplicateData(Data=nullplaceholder_3, Number=tstat_2.Length, Order=True)  # -> simplify(Data)
weave_2 = Weave(Pattern=graft(r_h_yes_no_3), Stream0=sdiff_2, Stream1=dup_2, NullGaps=False)

# ---- group: Center
c_0 = Brep(simplify(weave_2))

# ----
C = Brep(c_0)
c_names_2 = Text(c_names)

nullplaceholder_4 = Data(nullplaceholder)
tstat_3 = TreeStatistics(Tree=move_8.Geometry)  # -> Paths, graft(Length), Count
r_h_yes_no_4 = Boolean(r_h_yes_no)

dup_3 = DuplicateData(Data=nullplaceholder_4, Number=tstat_3.Length, Order=True)  # -> simplify(Data)

weave_3 = Weave(Pattern=graft(r_h_yes_no_4), Stream0=move_8.Geometry, Stream1=dup_3, NullGaps=False)

r_holex_2_2 = Integer(expr("x/2", r_holex_2))
r_holey_2_2 = Integer(expr("x/2", r_holey_2))
neg_11 = Negative(Value=r_holey_2_2)
neg_12 = Negative(Value=r_holex_2_2)
dom_3 = ConstructDomain(DomainStart=neg_11, DomainEnd=r_holey_2_2)
dom_4 = ConstructDomain(DomainStart=neg_12, DomainEnd=r_holex_2_2)

# ---- group: R (continued)
extr_15 = Extrude(Base=weave_3, Direction=Z_10)  # -> simplify(Extrusion)
Z_12 = UnitZ(Factor=subtraction_6)  # -> graft(UnitVector)

# ----
area_2 = Area(Geometry=extr_15)  # -> Area, Centroid
planar = IsPlanar(Surface=extr_15, Interior=True)  # -> Planar, Plane
pl_origin = PlaneOrigin(Base=planar.Plane, Origin=area_2.Centroid)
rectangle_2 = Rectangle(Plane=pl_origin, XSize=dom_4, YSize=dom_3, Radius=0)  # -> Rectangle, Length

rdiff = RegionDifference(CurvesA=graft(extr_15), CurvesB=graft(rectangle_2.Rectangle))
boundary_2 = BoundarySurfaces(Edges=rdiff)  # -> simplify(Surfaces)
pshift_2 = ShiftPaths(Data=boundary_2, Offset=-1)
extr_16 = Extrude(Base=pshift_2, Direction=merge_14)

# ---- group: R (continued)
item_12 = ListItem(List=extr_16, Index=0, Wrap=True)  # -> Item, Item1
move_9 = Move(Geometry=extr_16, Motion=Z_12)  # -> simplify(Geometry), Transform
item_13 = ListItem(List=move_9.Geometry, Index=0, Wrap=True)  # -> Item, Item1

# ---- group: V_Reinforcement
r_0 = Brep(item_12.Item)
r_1 = Brep(item_12.Item1)
r_2 = Brep(item_13.Item)
r_3 = Brep(item_13.Item1)

# ----
item_14 = ListItem(List=hsl_2, Index=0, Wrap=True)  # -> Item, Item1, Item2, Item3, Item4, Item5, Item6
merge_16 = Merge(Data1=h_0, Data2=h_1, Data3=h_2, Data4=h_3, Data5=h_4, Data6=h_5, Data7=h_6, Data8=h_7, Data9=h_8, Data10=h_9)  # -> simplify(Result)
merge_17 = Merge(Data1=t_0, Data2=t_1)  # -> simplify(Result)
merge_18 = Merge(Data1=s_0, Data2=s_1)  # -> simplify(Result)
merge_19 = Merge(Data1=f_0, Data2=f_1, Data3=f_2, Data4=f_3)  # -> simplify(Result)
merge_20 = Merge(Data1=b_0, Data2=b_1, Data3=b_2, Data4=b_3)  # -> simplify(Result)
merge_21 = Merge(Data1=r_0, Data2=r_1, Data3=r_2, Data4=r_3)  # -> simplify(Result)
preview_15 = CustomPreview(Geometry=merge_17, Material=item_14.Item)
preview_16 = CustomPreview(Geometry=merge_18, Material=item_14.Item1)
preview_17 = CustomPreview(Geometry=c_0, Material=item_14.Item2)
preview_18 = CustomPreview(Geometry=merge_19, Material=item_14.Item3)
preview_19 = CustomPreview(Geometry=merge_20, Material=item_14.Item4)
preview_20 = CustomPreview(Geometry=merge_21, Material=item_14.Item5)
preview_21 = CustomPreview(Geometry=merge_16, Material=item_14.Item6)
volume = Volume(Geometry=merge_17)  # -> Volume, Centroid
volume_2 = Volume(Geometry=merge_18)  # -> Volume, Centroid
volume_3 = Volume(Geometry=c_0)  # -> Volume, Centroid
volume_4 = Volume(Geometry=merge_19)  # -> Volume, Centroid
volume_5 = Volume(Geometry=merge_20)  # -> Volume, Centroid
volume_6 = Volume(Geometry=merge_21)  # -> Volume, Centroid
volume_7 = Volume(Geometry=merge_16)  # -> Volume, Centroid
dot_8 = AnnotationDot(Location=volume.Centroid, PrimaryText=t_names)  # -> AnnotationDot, Location, PrimaryText
dot_9 = AnnotationDot(Location=volume_2.Centroid, PrimaryText=s_names)  # -> AnnotationDot, Location, PrimaryText
dot_10 = AnnotationDot(Location=volume_3.Centroid, PrimaryText=c_names)  # -> AnnotationDot, Location, PrimaryText
dot_11 = AnnotationDot(Location=volume_4.Centroid, PrimaryText=f_names)  # -> AnnotationDot, Location, PrimaryText
dot_12 = AnnotationDot(Location=volume_5.Centroid, PrimaryText=b_names)  # -> AnnotationDot, Location, PrimaryText
dot_13 = AnnotationDot(Location=volume_6.Centroid, PrimaryText=r_names)  # -> AnnotationDot, Location, PrimaryText
dot_14 = AnnotationDot(Location=volume_7.Centroid, PrimaryText=h_names)  # -> AnnotationDot, Location, PrimaryText
preview_22 = CustomPreview(Geometry=dot_8.AnnotationDot, Material=item_14.Item)
preview_23 = CustomPreview(Geometry=dot_9.AnnotationDot, Material=item_14.Item1)
preview_24 = CustomPreview(Geometry=dot_10.AnnotationDot, Material=item_14.Item2)
preview_25 = CustomPreview(Geometry=dot_11.AnnotationDot, Material=item_14.Item3)
preview_26 = CustomPreview(Geometry=dot_12.AnnotationDot, Material=item_14.Item4)
preview_27 = CustomPreview(Geometry=dot_13.AnnotationDot, Material=item_14.Item5)
preview_28 = CustomPreview(Geometry=dot_14.AnnotationDot, Material=item_14.Item6)

T = Brep(merge_17)
t_names_2 = Text(t_names)

S = Brep(merge_18)
s_names_2 = Text(s_names)

R = Brep(merge_21)
r_names_2 = Text(r_names)

H = Brep(merge_16)
h_names_2 = Text(h_names)

entwine = Entwine(Branch0X=T, Branch1X=S, Branch2X=C, Branch3X=fb_v, Branch4X=fb_h, Branch5X=R, Branch6X=H, FlattenInputs=False)  # -> simplify(Result)

cluster_2 = Cluster_2(T=t_names_2)
cluster_3 = Cluster_2(T=s_names_2)
cluster_4 = Cluster_2(T=c_names_2)
cluster_5 = Cluster_2(T=r_names_2)
cluster_6 = Cluster_2(T=h_names_2)

entwine_2 = Entwine(
    Branch00=t_names_2,
    Branch01=s_names_2,
    Branch02=c_names_2,
    Branch03=fb_v_names,
    Branch04=fb_h_names,
    Branch05=r_names_2,
    Branch06=h_names_2,
    FlattenInputs=True)
entwine_3 = Entwine(
    Branch00=cluster_2,
    Branch01=cluster_3,
    Branch02=cluster_4,
    Branch03="FB_V",
    Branch04="FB_H",
    Branch05=cluster_5,
    Branch06=cluster_6,
    FlattenInputs=True)
dup_4 = DuplicateData(Data=entwine_2, Number=lng, Order=True)  # -> simplify(Data)
tstat_4 = TreeStatistics(Tree=entwine_2)  # -> Paths, Length, Count
dup_5 = DuplicateData(Data=entwine_3, Number=lng, Order=True)  # -> simplify(graft(Data))
partition = PartitionList(List=dup_4, Size=graft(tstat_4.Length))  # -> simplify(Chunks)
py3_3 = Python3Script(breps=entwine, functions=dup_5, names=partition)  # -> out, simplify(a), simplify(f), simplify(n); inputs breps: list of Brep, functions: String, names: list of String
# ---------- py3_3: Python ----------
import Rhino.Geometry as rg
from itertools import zip_longest

def set_user_string(geometry, key, value):
    if geometry is None:
        return False
    return geometry.SetUserString(key, value)

key_name = "DATAB_PART_NAME"
key_function = "DATAB_FUNCTION"

if isinstance(functions, str):
    functions = [functions]

default_function = functions[0] if functions else ""

for brep, function, name in zip_longest(breps, functions, names, fillvalue=None):
    geo = brep.Value if hasattr(brep, 'Value') else brep
    if geo is None:
        continue  # skip nulls entirely
    set_user_string(geo, key_function, function if function is not None else default_function)
    set_user_string(geo, key_name, name)

a = [b.Value if hasattr(b, 'Value') else b for b in breps]

f = [geo.GetUserString(key_function) if geo is not None else None for geo in a]
n = [geo.GetUserString(key_name)     if geo is not None else None for geo in a]
# ---------- end py3_3 ----------
clean = CleanTree(RemoveNulls=True, RemoveInvalid=True, RemoveEmpty=invert(False), Tree=py3_3.n)  # -> simplify(Tree)
clean_2 = CleanTree(RemoveNulls=True, RemoveInvalid=True, RemoveEmpty=invert(False), Tree=py3_3.f)  # -> simplify(Tree)
clean_3 = CleanTree(RemoveNulls=True, RemoveInvalid=True, RemoveEmpty=invert(False), Tree=py3_3.a)  # -> simplify(Tree)
path_mapper = PathMapper(clean_3, source="{A;B}", target="{B}")
path_mapper_2 = PathMapper(clean_2, source="{A;B}", target="{B}")
path_mapper_3 = PathMapper(clean, source="{A;B}", target="{B}")
film_2 = Panel(path_mapper_3)

# ----
# FB_H / FB_V / R
panel_14 = Panel("0")
t_joint_options = TJointOptions(ToolDiameter=tooldiameter, TJointStyle=panel_14)
jointtype_filter = ValueList({"None": -1, "Zip": 0, "CType": 1, "TType": 2, "Slot": 3, "Cutout": 4}, selected="TType")
panel_15 = Panel("""FB_V
FB_H
R""")
joints_wizard_options = JointsWizardOptions(T=t_joint_options, AllowedTypes=jointtype_filter)
sorting = Python3Script(parts=path_mapper, toJoin=panel_15)  # -> out, simplify(other_parts), joint_parts; inputs parts: list of Brep, toJoin: list of String
# ---------- sorting: Python ----------
other_parts = []
joint_parts = []


for p in parts:
    inIt = False
    function = p.GetUserString("DATAB_FUNCTION")
    for t in toJoin:
        print(function,t)
        if t == function:
            inIt = True
    if inIt:
        joint_parts.append(p)
    else:
        other_parts.append(p)
# ---------- end sorting ----------

aggregate_solver = AggregateSolver(Breps0=sorting.joint_parts, Options=joints_wizard_options)  # -> simplify(Output0), Output1, Skipped, Logs

brep_2 = Brep([aggregate_solver.Output0, sorting.other_parts])

# ----
# H / FB_V
tab_pattern = ValueList({"Linear": 0, "Alternating": 1, "Orphan": 2, "Custom": 3}, selected="Custom")
panel_16 = Panel("""2
1.5
2""")
tab_size_pattern = TabSizePattern(Pattern=tab_pattern, Multipliers=panel_16)
t_joint_options_2 = TJointOptions(ToolDiameter=tooldiameter_2, TabSizePattern=tab_size_pattern, TJointStyle="0")
jointtype_filter_2 = ValueList({"None": -1, "Zip": 0, "CType": 1, "TType": 2, "Slot": 3, "Cutout": 4}, selected="TType")
panel_17 = Panel("""H
FB_V""")
joints_wizard_options_2 = JointsWizardOptions(T=t_joint_options_2, AllowedTypes=jointtype_filter_2)
sorting_2 = Python3Script(parts=brep_2, toJoin=panel_17)  # -> out, simplify(other_parts), joint_parts; inputs parts: list of Brep, toJoin: list of String; same code as sorting

aggregate_solver_2 = AggregateSolver(Breps0=sorting_2.joint_parts, Options=joints_wizard_options_2)  # -> simplify(Output0), Output1, Skipped, Logs

brep_3 = Brep([aggregate_solver_2.Output0, sorting_2.other_parts])

tab_pattern_2 = ValueList({"Linear": 0, "Alternating": 1, "Orphan": 2, "Custom": 3}, selected="Custom")
jointtype_filter_3 = ValueList({"None": -1, "Zip": 0, "CType": 1, "TType": 2, "Slot": 3, "Cutout": 4}, selected="CType")
panel_18 = Panel("""FB_V
S""")
sorting_3 = Python3Script(parts=brep_3, toJoin=panel_18)  # -> out, other_parts, joint_parts; inputs parts: list of Brep, toJoin: list of String
# ---------- sorting_3: Python ----------
other_parts = []
joint_parts = []


for p in parts:
    inIt = False
    function = p.GetUserString("DATAB_FUNCTION")
    for t in toJoin:
        print(function,t)
        if t in function:
            inIt = True
    if inIt:
        joint_parts.append(p)
    else:
        other_parts.append(p)
# ---------- end sorting_3 ----------

py3_4 = Python3Script(parts=sorting_3.joint_parts, function=partwithtabs)  # -> out, edge_lengths; inputs parts: tree of Brep
# ---------- py3_4: Python ----------
import rhinoscriptsyntax as rs
import Rhino.Geometry as rg
from Grasshopper import DataTree
from Grasshopper.Kernel.Data import GH_Path

def get_longest_interior_edge(brep):
    interior_edge_lengths = []
    for edge in brep.Edges:
        if edge.Valence == rg.EdgeAdjacency.Interior:
            interior_edge_lengths.append(edge.GetLength())
    if not interior_edge_lengths:
        return None
    interior_edge_lengths.sort(reverse=True)
    return interior_edge_lengths[0]


edge_lengths = DataTree[object]()

for i, branch in enumerate(parts.Branches):
    path = parts.Path(i)
    if not branch:
        edge_lengths.Add(None, path)
        continue
    p = branch[0]
    f = p.GetUserString("DATAB_FUNCTION")
    matches = any(t in f for t in function)
    if matches:
        b = rs.coercebrep(p)
        length = get_longest_interior_edge(b)
        edge_lengths.Add(length, path)
    else:
        edge_lengths.Add(None, path)
# ---------- end py3_4 ----------
panel_19 = Panel(py3_4.edge_lengths)
py3_5 = Python3Script(total_length=py3_4.edge_lengths, tab_size=Slider(100, range=45..150), nr_of_tabs=Slider(4, range=2..6))  # -> out, result; inputs total_length: tree of Double, tab_size: Double, nr_of_tabs: Int32
# ---------- py3_5: Python ----------
from Grasshopper import DataTree
from Grasshopper.Kernel.Data import GH_Path

result = DataTree[object]()

for i, branch in enumerate(total_length.Branches):
    path = total_length.Path(i)
    tl = branch[0]  # one value per branch, matching previous logic

    if not distance_from_ends:
        max_tabs = int(tl // tab_size)
        nr = min(nr_of_tabs, max_tabs)

        total_rest = tl - tab_size * nr
        rest_tab_size = total_rest / (nr + 1)

        branch_result = [rest_tab_size]
        for tab in range(nr):
            branch_result.append(tab_size)
            branch_result.append(rest_tab_size)

    else:
        total_length_without_ends = tl - distance_from_ends * 2

        max_tabs = int(total_length_without_ends // tab_size)
        nr = min(nr_of_tabs, max_tabs)

        total_rest = total_length_without_ends - tab_size * nr
        rest_tab_size = total_rest / (nr - 1) if nr > 1 else 0

        branch_result = [distance_from_ends]
        for tab in range(nr - 1):
            branch_result.append(tab_size)
            branch_result.append(rest_tab_size)

        branch_result.append(tab_size)
        branch_result.append(distance_from_ends)

    for val in branch_result:
        result.Add(val, path)
# ---------- end py3_5 ----------
filter_2 = StreamFilter(Gate=list, Stream0=py3.P, Stream1=py3_5.result)  # -> simplify(Stream)

tab_size_pattern_2 = TabSizePattern(Pattern=tab_pattern_2, Multipliers=filter_2)
c_joint_options = CJointOptions(ToolDiameter=tooldiameter_3, PocketDepthRatio="0.5", TabSizePattern=tab_size_pattern_2, CJointStyle=0)
joints_wizard_options_3 = JointsWizardOptions(C=c_joint_options, AllowedTypes=jointtype_filter_3)

panel_21 = Panel(py3_5.result)
aggregate_solver_3 = AggregateSolver(Breps0=sorting_3.joint_parts, Options=joints_wizard_options_3)  # -> simplify(Output0), Output1, Skipped, Logs
brep_4 = Brep([aggregate_solver_3.Output0, sorting_3.other_parts])
panel_22 = Panel(sorting_3.joint_parts)

# ----
# FB_V / FB_H
panel_23 = Panel("""FB_V
FB_H""")
sorting_4 = Python3Script(parts=brep_4, toJoin=panel_23)  # -> out, simplify(other_parts), joint_parts; inputs parts: list of Brep, toJoin: list of String; same code as sorting_3
list_3 = ValueList({"Standard Options": 0, "T Slot Options": 1, "KieferFilm Options": 2, "DuckFeet A-B Options": 3}, selected="Standard Options")
filter_3 = StreamFilter(Gate=list_3, Stream0=standard_options, Stream1=t_slot_options, Stream2=kieferfilm_options, Stream3=duckfeet_a_b_options)

aggregate_solver_4 = AggregateSolver(Breps0=sorting_4.joint_parts, Options=filter_3)  # -> simplify(Output0), Output1, Skipped, Logs

brep_5 = Brep([aggregate_solver_4.Output0, sorting_4.other_parts])

tab_pattern_3 = ValueList({"Linear": 0, "Alternating": 1, "Orphan": 2, "Custom": 3}, selected="Custom")
panel_24 = Panel("""2
1
2""")
panel_25 = Panel("""FB_H
S""")
tab_size_pattern_3 = TabSizePattern(Pattern=tab_pattern_3, Multipliers=panel_24)
c_joint_options_2 = CJointOptions(ToolDiameter=tooldiameter_4, PocketDepthRatio="0.5", TabSizePattern=tab_size_pattern_3, CJointStyle=0)
sorting_5 = Python3Script(parts=brep_5, toJoin=panel_25)  # -> out, simplify(other_parts), joint_parts; inputs parts: list of Brep, toJoin: list of String; same code as sorting_3
jointtype_filter_4 = ValueList({"None": -1, "Zip": 0, "CType": 1, "TType": 2, "Slot": 3, "Cutout": 4}, selected="CType")
joints_wizard_options_4 = JointsWizardOptions(C=c_joint_options_2, AllowedTypes=jointtype_filter_4)
aggregate_solver_5 = AggregateSolver(Breps0=sorting_5.joint_parts, Options=joints_wizard_options_4)  # -> simplify(Output0), Output1, Skipped, Logs

brep_6 = Brep([aggregate_solver_5.Output0, sorting_5.other_parts])

# ----
# FB_H / T
tab_pattern_4 = ValueList({"Linear": 0, "Alternating": 1, "Orphan": 2, "Custom": 3}, selected="Custom")
panel_26 = Panel("""T
FB_H""")
sorting_6 = Python3Script(parts=brep_6, toJoin=panel_26)  # -> out, simplify(other_parts), joint_parts; inputs parts: list of Brep, toJoin: list of String; same code as sorting
jointtype_filter_5 = ValueList({"None": -1, "Zip": 0, "CType": 1, "TType": 2, "Slot": 3, "Cutout": 4}, selected="CType")

py3_6 = Python3Script(parts=sorting_6.joint_parts, function=partwithtabs_2)  # -> out, selected_parts, edge_length; inputs parts: list of Brep
# ---------- py3_6: Python ----------
import rhinoscriptsyntax as rs
import Rhino.Geometry as rg

selected_parts = []

for p in parts:
    inIt = False
    f = p.GetUserString("DATAB_FUNCTION")
    for t in function:
        print(f,t)
        if t in f:
            inIt = True
    if inIt:
        selected_parts.append(p)


def get_longest_interior_edge(brep):
    """
    Replicates the GH logic:
    Brep Edges -> filter interior edges -> get lengths -> sort -> return max
    """
    interior_edge_lengths = []

    for edge in brep.Edges:
        # Interior edges have exactly 2 adjacent faces (Valence == 2)
        if edge.Valence == rg.EdgeAdjacency.Interior:
            length = edge.GetLength()
            interior_edge_lengths.append(length)

    if not interior_edge_lengths:
        return None

    # Sort descending, take the first (longest)
    interior_edge_lengths.sort(reverse=True)
    return interior_edge_lengths[0]


if selected_parts:
    for b in selected_parts:
        b = rs.coercebrep(b)
        edge_length = get_longest_interior_edge(b)
# ---------- end py3_6 ----------
py3_7 = Python3Script(
    total_length=py3_6.edge_length,
    tab_size=Slider(100, range=45..150),
    nr_of_tabs=Slider(3, range=2..6),
    distance_from_ends=Slider(45, range=45..150))  # -> out, result; inputs total_length: Double, tab_size: Double, nr_of_tabs: Int32
# ---------- py3_7: Python ----------
if not distance_from_ends:
    # Calculate max tabs that fit (need at least 1 spacing gap between each tab)
    max_tabs = int(total_length // tab_size)
    nr_of_tabs = min(nr_of_tabs, max_tabs)

    total_rest = total_length - tab_size * nr_of_tabs
    rest_tab_size = total_rest / (nr_of_tabs + 1)

    result = [rest_tab_size]
    for tab in range(nr_of_tabs):
        result.append(tab_size)
        result.append(rest_tab_size)

else:
    total_length_without_ends = total_length - distance_from_ends * 2

    # Calculate max tabs that fit within the inner region
    # Need (nr_of_tabs - 1) gaps between tabs, so: nr_of_tabs * tab_size + (nr_of_tabs - 1) * 0 <= inner_length
    max_tabs = int(total_length_without_ends // tab_size)
    nr_of_tabs = min(nr_of_tabs, max_tabs)

    total_rest = total_length_without_ends - tab_size * nr_of_tabs
    rest_tab_size = total_rest / (nr_of_tabs - 1) if nr_of_tabs > 1 else 0

    result = [distance_from_ends]
    for tab in range(nr_of_tabs - 1):
        result.append(tab_size)
        result.append(rest_tab_size)

    result.append(tab_size)
    result.append(distance_from_ends)
# ---------- end py3_7 ----------
panel_27 = Panel(py3_7.result)
filter_4 = StreamFilter(Gate=list, Stream0=py3_2.P, Stream1=py3_7.result)  # -> simplify(Stream)

tab_size_pattern_4 = TabSizePattern(Pattern=tab_pattern_4, Multipliers=filter_4)
c_joint_options_3 = CJointOptions(ToolDiameter=tooldiameter_5, PocketDepthRatio="0.5", TabSizePattern=tab_size_pattern_4, CJointStyle=0)
joints_wizard_options_5 = JointsWizardOptions(C=c_joint_options_3, AllowedTypes=jointtype_filter_5)
aggregate_solver_6 = AggregateSolver(Breps0=sorting_6.joint_parts, Options=joints_wizard_options_5)  # -> simplify(Output0), Output1, Skipped, Logs

brep_7 = Brep([aggregate_solver_6.Output0, sorting_6.other_parts])

py3_8 = Python3Script(parts=brep_7)  # -> out, a; inputs parts: tree of Brep
# ---------- py3_8: Python ----------
from Grasshopper import DataTree
from Grasshopper.Kernel.Data import GH_Path

a = DataTree[object]()

for i, branch in enumerate(parts.Branches):
    path = parts.Path(i)
    for p in branch:
        function = p.GetUserString("DATAB_FUNCTION")
        print(f"branch {i}: {function}")
        a.Add(function, path)
# ---------- end py3_8 ----------
cset = CreateSet(List=py3_8.a)  # -> Set, Map
col = Colour(simplify(graft(gradient)))
tree = CreateTree(Data=brep_7, Path=cset.Map)

panel_28 = Panel(py3_8.a)
bang_2 = ExplodeTree(Data=tree)  # -> Branch0, Branch1, Branch2, Branch3, Branch4, Branch5, Branch6
branch = TreeBranch(Tree=tree, Path="2", MaintainPaths=True)
cull = CullPattern(List=branch, CullPattern=panel_3)
entwine_4 = Entwine(
    Branch00=bang_2.Branch0,
    Branch01=bang_2.Branch1,
    Branch02=cull,
    Branch03=bang_2.Branch3,
    Branch04=bang_2.Branch4,
    Branch05=bang_2.Branch5,
    Branch06=bang_2.Branch6,
    FlattenInputs=True)
filter_5 = StreamFilter(Gate=0, Stream0=entwine_4, Stream1=tree)  # -> simplify(Stream)

preview_29 = CustomPreview(Geometry=filter_5, Material=col)

py3_9 = Python3Script(breps=filter_5)  # -> out, a, n; inputs breps: list of Brep
# ---------- py3_9: Python ----------
# inputs: breps

a = []
n = []

for b in breps:
    geo = b.Value if hasattr(b, 'Value') else b
    if geo is None:
        a.append(None)
        n.append(None)
        continue
    a.append(geo.GetUserString("DATAB_FUNCTION"))
    n.append(geo.GetUserString("DATAB_PART_NAME"))
# ---------- end py3_9 ----------
py3_10 = Python3Script(meshes=filter_5, functions=py3_9.a, names=py3_9.n)  # -> out, a, flatten(f), n; inputs meshes: list of Mesh, functions: list, names: list
# ---------- py3_10: Python ----------
import Rhino.Geometry as rg
from itertools import zip_longest

def set_user_string(geometry, key, value):
    if geometry is None:
        return False
    return geometry.SetUserString(key, value)

key_name = "DATAB_PART_NAME"
key_function = "DATAB_FUNCTION"

if isinstance(functions, str):
    functions = [functions]

default_function = functions[0] if functions else ""

for mesh, function, name in zip_longest(meshes, functions, names, fillvalue=None):
    geo = mesh.Value if hasattr(mesh, 'Value') else mesh
    if geo is None:
        continue
    set_user_string(geo, key_function, function if function is not None else default_function)
    set_user_string(geo, key_name, name)

a = [m.Value if hasattr(m, 'Value') else m for m in meshes]

f = [geo.GetUserString(key_function) if geo is not None else None for geo in a]
n = [geo.GetUserString(key_name)     if geo is not None else None for geo in a]
# ---------- end py3_10 ----------
mesh = Mesh(flatten(py3_10.a))
c_bake = ContextBake(Content=mesh)

# ----
# NESTING
sorting_7 = Python3Script(parts=brep_7, toJoin=film)  # -> out, simplify(other_parts), joint_parts; inputs parts: list of Brep, toJoin: list of String; same code as sorting
kiefer = Brep(flatten(sorting_7.other_parts))
film_3 = Brep(flatten(sorting_7.joint_parts))
sheets = Geometry(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)

# ---- group: Hops
run = GetBoolean(Toggle(True), AtLeast=1, AtMost=1, FalseValue="False", TreeAccess=False, TrueValue="True")
sheets_2 = GetGeometry(sheets, AnnotationTypeFilter=3966, AtLeast=1, AtMost=1, DeleteInput=False, Filter=1074081855, TreeAccess=False)

# ----
nest = Nest(Breps=kiefer, TheSheetGeometryAsACurveDefaultIs2500x1250=sheets_2, TrueSolveFalseIdleDefaultFalse=run)  # -> Sheets, Unassigned
nest_2 = Nest(Breps=film_3, TheSheetGeometryAsACurveDefaultIs2500x1250=sheets_2, TrueSolveFalseIdleDefaultFalse=run)  # -> Sheets, Unassigned

aggregatesheets = AggregateSheetProjections(PlywoodSheets=nest.Sheets)  # -> SheetGeometry, Outers, Inners, Pockets, PocketDepths, Bores, BoresHeights, StraightCuts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
aggregatesheets_2 = AggregateSheetProjections(PlywoodSheets=nest_2.Sheets)  # -> SheetGeometry, Outers, Inners, Pockets, PocketDepths, Bores, BoresHeights, StraightCuts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
lng_2 = ListLength(List=flatten(aggregatesheets.SheetGeometry))
lng_3 = ListLength(List=flatten(aggregatesheets_2.SheetGeometry))

tstat_5 = TreeStatistics(Tree=aggregatesheets_2.SheetGeometry)  # -> Paths, Length, Count
tstat_6 = TreeStatistics(Tree=aggregatesheets.SheetGeometry)  # -> Paths, Length, Count
equals = Equality(FirstNumber=tstat_5.Length, SecondNumber="0")  # -> graft(Equality), Inequality
equals_2 = Equality(FirstNumber=tstat_6.Length, SecondNumber="0")  # -> graft(Equality), Inequality
cull_2 = CullPattern(List=aggregatesheets_2.Text, CullPattern=invert(simplify(equals.Equality)))
cull_3 = CullPattern(List=aggregatesheets.Text, CullPattern=invert(simplify(equals_2.Equality)))
cull_4 = CullPattern(List=aggregatesheets_2.Outers, CullPattern=invert(simplify(equals.Equality)))
cull_5 = CullPattern(List=aggregatesheets.Outers, CullPattern=invert(simplify(equals_2.Equality)))
clean_4 = CleanTree(RemoveNulls=True, RemoveInvalid=True, RemoveEmpty=invert(False), Tree=cull_3)
clean_5 = CleanTree(RemoveNulls=True, RemoveInvalid=True, RemoveEmpty=invert(False), Tree=cull_4)
clean_6 = CleanTree(RemoveNulls=True, RemoveInvalid=True, RemoveEmpty=invert(False), Tree=cull_2)
clean_7 = CleanTree(RemoveNulls=True, RemoveInvalid=True, RemoveEmpty=invert(False), Tree=cull_5)
clean_8 = CleanTree(RemoveNulls=True, RemoveInvalid=True, RemoveEmpty=invert(False), Tree=aggregatesheets_2.SheetGeometry)
clean_9 = CleanTree(RemoveNulls=True, RemoveInvalid=True, RemoveEmpty=invert(False), Tree=aggregatesheets.SheetGeometry)

c_bake_2 = ContextBake(K_SheetNr=lng_2)
c_bake_3 = ContextBake(Content=clean_9)
c_bake_4 = ContextBake(K_Nested=clean_7)
c_bake_5 = ContextBake(Content=clean_4)

c_bake_6 = ContextBake(F_SheetNr=lng_3)
c_bake_7 = ContextBake(Content=clean_8)
c_bake_8 = ContextBake(Content=clean_6)
c_bake_9 = ContextBake(F_Nested=clean_5)

# ==== cluster Cluster
L = ClusterInput()
lng = ListLength(List=L)  # -> expr("x-2", Length)
dom = ConstructDomain(DomainStart="1", DomainEnd=lng)
subset = SubList(List=L, Domain=dom, Wrap=True)  # -> List, Index
Y = UnitY(Factor=1)
evalsrf = EvaluateSurface(Surface=subset.List, Point="0,0")  # -> Point, Normal, UDirection, VDirection, Frame
dprod = DotProduct(VectorA=evalsrf.Normal, VectorB=Y, Unitize=False)
abs = Absolute(Value=dprod)
dispatch = Dispatch(List=subset.List, DispatchPattern=abs)  # -> ListA, ListB
item = ListItem(List=dispatch.ListA, Index=0, Wrap=True)  # -> Item, Item1
item_2 = ListItem(List=dispatch.ListB, Index=0, Wrap=True)  # -> Item, Item1
i = ClusterOutput(item.Item)
item_1 = ClusterOutput(item.Item1)
i_2 = ClusterOutput(item_2.Item)
item_1_2 = ClusterOutput(item_2.Item1)

# ==== cluster NameCreator
L = ClusterInput()
lng = ListLength(List=L)
series = Series(Start=0, Step=1, Count=lng)
A = ClusterInput()
concat = Concatenate(FragmentA=A, FragmentB="_", FragmentC=series)
volume = Volume(Geometry=L)  # -> Volume, Centroid
R = ClusterOutput(concat)
C = ClusterOutput(volume.Centroid)

# ==== cluster Cluster_2
T = ClusterInput()
chars = Characters(Text=T)  # -> flatten(Result), Unicode
item = ListItem(List=chars.Result, Index=0, Wrap=True)
i = ClusterOutput(item)

# ==== cluster TSlotOptions

# ---- group: t to slot
t_joint_options = TJointOptions(TJointStyle=Slider(1, range=0..10))
joints_wizard_options = JointsWizardOptions(T=t_joint_options)

# ----
options = ClusterOutput(joints_wizard_options)

# ==== cluster KieferFilmOptions

# ---- group: kiefer zu film pockets
tab_pattern = ValueList({"Linear": 0, "Alternating": 1, "Orphan": 2, "Custom": 3}, selected="Custom")
panel = Panel("""200
100
600
100
200""")
tab_size_pattern = TabSizePattern(Pattern=tab_pattern, Multipliers=panel)
t_joint_options = TJointOptions(
    CrunchFactor="-0.1",
    ThicknessTolerance=Slider(1, range=0..1),
    PocketDepthRatio=Slider(0.7, range=0..1),
    TabSizePattern=tab_size_pattern)
jointtype_filter = ValueList({"None": -1, "Zip": 0, "CType": 1, "TType": 2, "Slot": 3, "Cutout": 4}, selected="TType")
joints_wizard_options = JointsWizardOptions(T=t_joint_options, AllowedTypes=jointtype_filter)

# ----
options = ClusterOutput(joints_wizard_options)

# ==== cluster StandardOptions
joints_wizard_options = JointsWizardOptions()
options = ClusterOutput(joints_wizard_options)

# ==== cluster DuckFeetABOptions

# ---- group: a/b Duckfeet connection
tab_pattern = ValueList({"Linear": 0, "Alternating": 1, "Orphan": 2, "Custom": 3}, selected="Custom")
panel = Panel("""200
100
600
100
200""")
tab_size_pattern = TabSizePattern(Pattern=tab_pattern, Multipliers=panel)
t_joint_options = TJointOptions(ThicknessTolerance=Slider(1, range=0..1), TabSizePattern=tab_size_pattern)
jointtype_filter = ValueList({"None": -1, "Zip": 0, "CType": 1, "TType": 2, "Slot": 3, "Cutout": 4}, selected="TType")
joints_wizard_options = JointsWizardOptions(T=t_joint_options, AllowedTypes=jointtype_filter)

# ----
options = ClusterOutput(joints_wizard_options)
